# Grasshopper definition 64pin-socket.gh (Grasshopper 1.0.8)

number_slider = Slider(-1, range=-2..1)
number_slider_2 = Slider(2, range=0..10)
number_slider_3 = Slider(1.5, range=0..10)
multiplication = Multiplication(A=number_slider_2, B=number_slider_3)
number_slider_4 = Slider(2.54, range=0..10)
number_slider_5 = Slider(5, range=0..10)
number_slider_6 = Slider(32, range=0..100)
addition = Addition(A=number_slider_5, B=number_slider)
number_slider_7 = Slider(1.8, range=0..10)
number_slider_8 = Slider(3, range=0..10)
multiplication_2 = Multiplication(A=number_slider_5, B=number_slider_4)
multiplication_3 = Multiplication(A=addition, B=number_slider_4)
division = Division(A=number_slider_4, B=number_slider_2)
multiplication_4 = Multiplication(A=number_slider_6, B=number_slider_4)
subtraction = Subtraction(A=multiplication, B=Slider(1.7, range=-2..2))
subtraction_2 = Subtraction(A=multiplication, B=Slider(0.3, range=0..1))
addition_2 = Addition(A=multiplication_2, B=division)
division_2 = Division(A=multiplication_4, B=number_slider_2)
multiplication_5 = Multiplication(A=division_2, B=number_slider)
Z = UnitZ(Factor=subtraction)
Z_2 = UnitZ(Factor=subtraction_2)
addition_3 = Addition(A=multiplication_5, B=division)
addition_4 = Addition(A=number_slider_7, B=number_slider_3)
addition_5 = Addition(A=multiplication_3, B=division)
multiplication_6 = Multiplication(A=addition_5, B=number_slider)
multiplication_7 = Multiplication(A=addition_5, B=number_slider_2)
division_3 = Division(A=number_slider_8, B=number_slider_2)
multiplication_8 = Multiplication(A=division_3, B=number_slider)
pt = ConstructPoint(XCoordinate=multiplication_6, YCoordinate=multiplication_8, ZCoordinate=0)
subtraction_3 = Subtraction(A=division_2, B=number_slider_8)
series = Series(Start=addition_3, Step=number_slider_4, Count=number_slider_6)
multiplication_9 = Multiplication(A=multiplication_2, B=number_slider)
Z_3 = UnitZ(Factor=number_slider_3)
Z_4 = UnitZ(Factor=addition_4)
Y = UnitY(Factor=division_2)
pt_2 = ConstructPoint(XCoordinate=multiplication_2, YCoordinate=series, ZCoordinate=0)
pt_3 = ConstructPoint(XCoordinate=multiplication_9, YCoordinate=series, ZCoordinate=0)
cyl = Cylinder(Base=Y, Radius=Slider(1.3, range=0..10), Length=multiplication)
rectangle = Rectangle(Plane=pt, XSize=multiplication_7, YSize=number_slider_8, Radius=0)  # -> Rectangle, Length
box = CenterBox(Base=Z_4, X=addition_5, Y=division_2, Z=number_slider_3)
box_2 = CenterBox(Base=Z_3, X=addition_5, Y=subtraction_3, Z=number_slider_3)
box_3 = CenterBox(Base=Z_3, X=addition_2, Y=division_2, Z=number_slider_3)
Z_5 = UnitZ(Factor=number_slider_7)
move = Move(Geometry=[pt_2, pt_3], Motion=Z)  # -> Geometry, Transform
move_2 = Move(Geometry=[pt_2, pt_3], Motion=Z_2)  # -> Geometry, Transform
sunion = SolidUnion(Breps=[box, box_2])
extr = Extrude(Base=rectangle.Rectangle, Direction=Z_5)
cyl_2 = Cylinder(Base=move.Geometry, Radius=Slider(0.78, range=0..1), Length=multiplication)
cyl_3 = Cylinder(Base=[pt_2, pt_3], Radius=Slider(0.7, range=0..10), Length=multiplication)
cyl_4 = Cylinder(Base=move_2.Geometry, Radius=Slider(0.92, range=0..1), Length=multiplication)
cap = CapHoles(Brep=extr)
cap_2 = CapHoles(Brep=cyl_4)
cap_3 = CapHoles(Brep=cyl_2)
cap_4 = CapHoles(Brep=cyl_3)
sunion_2 = SolidUnion(Breps=[cap_4, cap_2, cap_3])
sdiff = SolidDifference(BrepsA=box_3, BrepsB=[sunion, cyl])
sunion_3 = SolidUnion(Breps=[sdiff, cap])
sdiff_2 = SolidDifference(BrepsA=sunion_3, BrepsB=sunion_2)
